# Grasshopper definition portfolio.gh (Grasshopper 1.0.8)

press_me = BooleanToggle(False)
portfolio = Python3Script(trigger=press_me)  # -> out, a; inputs trigger: Boolean
# ---------- portfolio: Python ----------
import urllib.request
import os

# Hardcoded GitHub raw PDF link
URL = "https://github.com/pinjusicmatea-23/portfolio/raw/main/matea_pinjusic_portfolio.pdf"

def get_unique_filename(folder, base_name, ext):
    """
    Finds a unique filename in 'folder' like base_name.pdf, base_name_1.pdf, base_name_2.pdf...
    """
    n = 0
    while True:
        if n == 0:
            candidate = f"{base_name}{ext}"
        else:
            candidate = f"{base_name}_{n}{ext}"
        filepath = os.path.join(folder, candidate)
        if not os.path.exists(filepath):
            return filepath
        n += 1

if trigger:
    try:
        # Downloads folder
        downloads = os.path.join(os.path.expanduser("~"), "Downloads")
        if not os.path.exists(downloads):
            os.makedirs(downloads)

        # Fixed base name
        base_name = "matea_pinjusic_portfolio"
        ext = ".pdf"

        # Get unique filename
        filepath = get_unique_filename(downloads, base_name, ext)

        # Download
        urllib.request.urlretrieve(URL, filepath)
        msg = "Downloaded to: " + filepath + ". Thank you for considering my application!"
    except Exception as e:
        msg = "Error: " + str(e)
else:
    msg = "Waiting, trigger to download..."

a = msg
# ---------- end portfolio ----------
panel = Panel(portfolio.a)
